# Grasshopper definition office.gh (Grasshopper 0.9.76)
# plug-ins: Python Interpreter

panel = Panel("""默认上下左右
对应北南西东""")
# 如果是四间就需要
# 四间房间的信息
panel_2 = Panel("""需要的房间信息有
1.长
2.宽
3.墙厚
4.开门位置
5.开门点
6.门洞大小""")
panel_3 = Panel("""上：0
下：1
左：2
右：3""")
旋转角度 = Slider(180, range=0..1000)
开洞点长度 = Slider(6400, range=0..10000)
门洞长度 = Slider(1397, range=0..10000)
宽 = Slider(9293, range=0..10000)
墙厚 = Slider(250, range=0..10000)
长 = Slider(9247, range=0..10000)
pt = Point()
pt_2 = Point(<point referenced from the Rhino model>)
list = ValueList({"上": 0, "下": 1, "左": 2, "右": 3}, selected="上")
list_2 = ValueList({"上": 0, "下": 1, "左": 2, "右": 3}, selected="右")
list_3 = ValueList({"上": 0, "下": 1, "左": 2, "右": 3}, selected="右")
list_4 = ValueList({"上": 0, "下": 1, "左": 2, "右": 3}, selected="右")
list_5 = ValueList({"上": 0, "下": 1, "左": 2, "右": 3}, selected="右")
list_6 = ValueList({"上": 0, "下": 1, "左": 2, "右": 3}, selected="右")
list_7 = ValueList({"上": 0, "下": 1, "左": 2, "右": 3}, selected="下")
list_8 = ValueList({"上": 0, "下": 1, "左": 2, "右": 3}, selected="右")
list_9 = ValueList({"上": 0, "下": 1, "左": 2, "右": 3}, selected="右")
list_10 = ValueList({"上": 0, "下": 1, "左": 2, "右": 3}, selected="右")
list_11 = ValueList({"上": 0, "下": 1, "左": 2, "右": 3}, selected="左")
list_12 = ValueList({"一间": 1, "二间": 2, "三间": 3, "四间": 4, "五间": 5, "六间": 6, "七间": 7, "八间": 8, "九间": 9, "十间": 10}, selected="十间")
list_13 = ValueList({"上": 0, "下": 1, "左": 2, "右": 3}, selected="左")
list_14 = ValueList({"上": 0, "下": 1, "左": 2, "右": 3}, selected="上")
list_15 = ValueList({"上": 0, "下": 1, "左": 2, "右": 3}, selected="上")
list_16 = ValueList({"上": 0, "下": 1, "左": 2, "右": 3}, selected="上")
list_17 = ValueList({"上": 0, "下": 1, "左": 2, "右": 3}, selected="上")
list_18 = ValueList({"上": 0, "下": 1, "左": 2, "右": 3}, selected="上")
list_19 = ValueList({"上": 0, "下": 1, "左": 2, "右": 3}, selected="右")
list_20 = ValueList({"上": 0, "下": 1, "左": 2, "右": 3}, selected="上")
merge = Merge(
    Data1=Slider(9158, range=0..10000),
    Data2=Slider(9048, range=0..10000),
    Data3=Slider(250, range=0..10000),
    Data4=list_11,
    Data5=Slider(142, range=0..10000),
    Data6=Slider(1168, range=0..10000))
merge_2 = Merge(
    Data1=list_7,
    Data2=list_2,
    Data3=list_5,
    Data4=list_6,
    Data5=list_9,
    Data6=list_8,
    Data7=list_3,
    Data8=list_4,
    Data9=list)
merge_3 = Merge(
    Data1=Slider(9133, range=0..10000),
    Data2=Slider(8945, range=0..10000),
    Data3=Slider(250, range=0..10000),
    Data4=list_13,
    Data5=Slider(142, range=0..10000),
    Data6=Slider(1168, range=0..10000))
merge_4 = Merge(
    Data1=Slider(8371, range=0..10000),
    Data2=Slider(7557, range=0..10000),
    Data3=Slider(250, range=0..10000),
    Data4=list_14,
    Data5=Slider(6163, range=0..10000),
    Data6=Slider(1168, range=0..10000))
merge_5 = Merge(
    Data1=Slider(7945, range=0..10000),
    Data2=Slider(7532, range=0..10000),
    Data3=Slider(250, range=0..10000),
    Data4=list_16,
    Data5=Slider(6163, range=0..10000),
    Data6=Slider(1168, range=0..10000))
merge_6 = Merge(
    Data1=Slider(7863, range=0..10000),
    Data2=Slider(7491, range=0..10000),
    Data3=Slider(250, range=0..10000),
    Data4=list_15,
    Data5=Slider(2763, range=0..10000),
    Data6=Slider(1332, range=0..10000))
merge_7 = Merge(
    Data1=Slider(7507, range=0..10000),
    Data2=Slider(7557, range=0..10000),
    Data3=Slider(250, range=0..10000),
    Data4=list_18,
    Data5=Slider(5683, range=0..10000),
    Data6=Slider(1712, range=0..10000))
merge_8 = Merge(Data1=长, Data2=宽, Data3=墙厚, Data4=list_10, Data5=开洞点长度, Data6=门洞长度)
merge_9 = Merge(
    Data1=Slider(8371, range=0..10000),
    Data2=Slider(7557, range=0..10000),
    Data3=Slider(250, range=0..10000),
    Data4=list_17,
    Data5=Slider(6163, range=0..10000),
    Data6=Slider(1168, range=0..10000))
merge_10 = Merge(
    Data1=Slider(9247, range=0..10000),
    Data2=Slider(8806, range=0..10000),
    Data3=Slider(250, range=0..10000),
    Data4=list_19,
    Data5=Slider(750, range=0..10000),
    Data6=Slider(7834, range=0..10000))
merge_11 = Merge(
    Data1=Slider(9680, range=0..10000),
    Data2=Slider(7557, range=0..10000),
    Data3=Slider(250, range=0..10000),
    Data4=list_20,
    Data5=Slider(6249, range=0..10000),
    Data6=Slider(1495, range=0..10000))
merge_12 = Merge(
    Data1=merge_8,
    Data2=merge_10,
    Data3=merge_11,
    Data4=merge_7,
    Data5=merge_9,
    Data6=merge_4,
    Data7=merge_5,
    Data8=merge_6,
    Data9=merge_3,
    Data10=merge)
cluster = Cluster(d1=pt_2, d2=旋转角度, d3=list_12, d4=merge_2, d5=merge_12)  # -> X, Y, i_2, R_4, i_3, C, R, i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

内圈左上角点 = Point(cluster.R)
内圈右下角点 = Point(cluster.R_2)
内圈右上角点 = Point(cluster.R_4)
开门位置 = Integer(cluster.i_2)
原点位置 = Point(cluster.pt_4)
runion = RegionUnion(Curves=cluster.C)
y向量 = Vector(cluster.Y)
x向量 = Vector(cluster.X)
房间宽 = Number(cluster.i)
房间长 = Number(cluster.i_3)

框长_x = Slider(1750, range=0..10000)
框宽_y = Slider(1726, range=0..10000)
走道长度 = Slider(1024, range=0..10000)
cluster_2 = Cluster_2(
    x=开门位置,
    y=内圈右上角点,
    z=原点位置,
    u=内圈左上角点,
    v=内圈右下角点,
    x_2=开门位置,
    y_2=房间长,
    z_2=房间宽,
    框长=框长_x,
    走道长度_2=走道长度,
    框宽=框宽_y,
    x_3=x向量,
    y_3=y向量,
    z_3=开门位置,
    内层墙壁壳=cluster.R_3)  # -> 框长_3, 框宽_3, x向量_2, y向量_2, R, 内层墙壁壳_3, L
python = PythonScript(
    x=flatten(cluster_2.R),
    y=flatten(cluster_2.L),
    vecoterz=flatten(cluster_2.x向量_2),
    vecoteru=flatten(cluster_2.y向量_2),
    v=cluster_2.框长_3,
    w=cluster_2.框宽_3,
    s=flatten(cluster_2.内层墙壁壳_3))  # -> out, list_1, frame_list; inputs x: list of Point3d, y: list of Int32, vecoterz: list of Vector3d, vecoteru: list of Vector3d, s: list of Curve
# ---------- python: Python ----------
#coding=utf-8

import rhinoscriptsyntax as rs
import Rhino as r
import ghpythonlib.components as ghc
import math
import random

n = 0
point_list = []
vecoter_x = []
vecoter_y = []
wall = []
frame_list = []
frame_x = float(v)
frame_y = float(w)
for i in range(len(y)):
    point_list.append([])
    n = int(n+y[i])
    for z in range(int(n-y[i]),n):
        point_list[i].append(x[z])   #按组将各个房间内的点区分开来
        
print(point_list[1])


for v_1 in vecoterz:
    vecoter_x.append(v_1)     #获取各平面的x向量

for v_2 in vecoteru:
    vecoter_y.append(v_2)     #获取各平面的y向量

for cur in s:
    wall.append(cur)   #获取墙壁



#定义框类
class Frame:
    def __init__(self,point,vecoterx,vecotery,weight,high):
        self.point = point
        self.vecoterx = vecoterx
        self.vecotery = vecotery
        self.weight = weight
        self.high = high
        self.frame_number = None
        self.table_high = int(450)    #框内办公桌的宽度
        self.chair_r = int(300)       #框内办公椅的半径
        self.smalltable_weight = int(800)  #小桌的长度
        self.plane = rs.PlaneFromFrame(point,vecoterx,vecotery)
        
    def rectangle(self,point,x,y):   #定义一个制作矩形的类方法
        point1 = rs.PointAdd(point,self.vecoterx*x)
        point2 = rs.PointAdd(point,self.vecotery*y)
        point3 = rs.PointAdd(point,self.vecoterx*x+self.vecotery*y)
        line1 = rs.AddLine(point,point1)
        line2 = rs.AddLine(point,point2)
        line3 = rs.AddLine(point1,point3)
        line4 = rs.AddLine(point2,point3)
        line_list = [line1,line2,line3,line4]
        return line_list
        
    def frame_draw(self): #定义画出框的内容操作
        number_1 = int(frame_x - self.smalltable_weight - self.table_high)
        number_2 = int(frame_y - self.table_high)
        line_list = []
        if self.frame_number == 0:
            smalltable_point = rs.PointAdd(self.point,self.vecoterx*number_1)
            table_point = rs.PointAdd(self.point,self.vecoterx*(frame_x-self.table_high))
            circle_point = rs.PointAdd(self.point,self.vecoterx*((frame_x-self.table_high)/2)+self.vecotery*(number_2/2+self.table_high))
            circle_plane = rs.PlaneFromFrame(circle_point,self.vecoterx,self.vecotery)
            line_list1 = self.rectangle(smalltable_point,self.smalltable_weight,self.table_high)
            line_list2 = self.rectangle(table_point,self.table_high,frame_y)
            line_list3 = rs.AddCircle(circle_plane,self.chair_r)
        if self.frame_number == 1:
            smalltable_point = rs.PointAdd(self.point,self.vecoterx*self.table_high)
            table_point = self.point
            circle_point = rs.PointAdd(self.point,self.vecoterx*(self.table_high+(frame_x-self.table_high)/2)+self.vecotery*(number_2/2+self.table_high))
            circle_plane = rs.PlaneFromFrame(circle_point,self.vecoterx,self.vecotery)
            line_list1 = self.rectangle(smalltable_point,self.smalltable_weight,self.table_high)
            line_list2 = self.rectangle(table_point,self.table_high,frame_y)
            line_list3 = rs.AddCircle(circle_plane,self.chair_r)
        if self.frame_number == 2:
            smalltable_point = rs.PointAdd(self.point,self.vecoterx*number_1+self.vecotery*number_2)
            table_point = rs.PointAdd(self.point,self.vecoterx*(frame_x - self.table_high))
            circle_point = rs.PointAdd(self.point,self.vecoterx*((frame_x-self.table_high)/2)+self.vecotery*(number_2/2))
            circle_plane = rs.PlaneFromFrame(circle_point,self.vecoterx,self.vecotery)
            line_list1 = self.rectangle(smalltable_point,self.smalltable_weight,self.table_high)
            line_list2 = self.rectangle(table_point,self.table_high,frame_y)
            line_list3 = rs.AddCircle(circle_plane,self.chair_r)
        if self.frame_number == 3:
            smalltable_point = rs.PointAdd(self.point,self.vecoterx*self.table_high+self.vecotery*number_2)
            table_point = self.point
            circle_point = rs.PointAdd(self.point,self.vecoterx*(self.table_high+(frame_x-self.table_high)/2)+self.vecotery*(number_2/2))
            circle_plane = rs.PlaneFromFrame(circle_point,self.vecoterx,self.vecotery)
            line_list1 = self.rectangle(smalltable_point,self.smalltable_weight,self.table_high)
            line_list2 = self.rectangle(table_point,self.table_high,frame_y)
            line_list3 = rs.AddCircle(circle_plane,self.chair_r)
        for line_line1 in line_list1:
            line_list.append(line_line1)
        for line_line2 in line_list2:
            line_list.append(line_line2)
        line_list.append(line_list3)
        return line_list
        
    def test_dir(self):
        test_distance = int(1000)    #定义测试距离
        room_value = [0,1,2,3]
        test_value = [0,0,0,0]
        point0 = rs.PointAdd(self.point,self.vecoterx*(frame_x/2))
        point1 = rs.PointAdd(self.point,self.vecoterx*frame_x+self.vecotery*(frame_y/2))
        point2 = rs.PointAdd(self.point,self.vecoterx*(frame_x/2)+self.vecotery*frame_y)
        point3 = rs.PointAdd(self.point,self.vecotery*(frame_y/2))
        point0_0 = rs.PointAdd(point0,self.vecotery*test_distance*-1)
        point1_1 = rs.PointAdd(point1,self.vecotery*test_distance)
        point2_2 = rs.PointAdd(point2,self.vecotery*test_distance)
        point3_3 = rs.PointAdd(point3,self.vecoterx*test_distance*-1)
        line_0 = rs.AddLine(point0,point0_0)
        line_1 = rs.AddLine(point1,point1_1)
        line_2 = rs.AddLine(point2,point2_2)
        line_3 = rs.AddLine(point3,point3_3)
        for h in test_list:
            if rs.PlanarCurveCollision(h,line_0):
                test_value[0] = 1
            if rs.PlanarCurveCollision(h,line_1):
                test_value[1] = 1
            if rs.PlanarCurveCollision(h,line_2):
                test_value[2] = 1
            if rs.PlanarCurveCollision(h,line_3):
                test_value[3] = 1

        if test_value[0] == 1:
            room_value.remove(0)
            room_value.remove(1)
        if test_value[1] == 1:
            if 0 in room_value:
                room_value.remove(0)
            room_value.remove(2)
        if test_value[2] == 1:
            if 2 in room_value:
                room_value.remove(2)
            room_value.remove(3)
        if test_value[3] == 1:
            if 1 in room_value:
                room_value.remove(1)
            if 3 in room_value:
                room_value.remove(3)
        if len(room_value) == 0:
            self.frame_number = 2
            print(2)
        else:
            random.shuffle(room_value)
            self.frame_number = room_value[0]
        print(self.frame_number)

#主程序
for room_list in range(len(point_list)):
    test_list = []
    test_list.append(wall[room_list])
    for frame_point in range(len(point_list[room_list])):
        frame_thing = Frame(point_list[room_list][frame_point],vecoter_x[room_list],vecoter_y[room_list],frame_x,frame_y)
        frame_thing.test_dir()
        draw_thing = frame_thing.frame_draw()
        for zz in draw_thing:
            test_list.append(zz)
            frame_list.append(zz)
# ---------- end python ----------

# ==== cluster Cluster
d1 = ClusterInput()
d2 = ClusterInput()
d3 = ClusterInput()
d4 = ClusterInput()
d5 = ClusterInput()
merge = Merge(Data1=d1, Data2=d2, Data3=d3, Data4=d4, Data5=d5)
panel = Panel(merge)
number_slider = Slider(3, range=0..10)
lng = ListLength(List=merge)
item = ListItem(List=merge, Index=3, Wrap=True)  # -> Item, Item1, Item2
item_2 = ListItem(List=merge, Index=1, Wrap=True)
item_3 = ListItem(List=merge, Index=2, Wrap=True)
item_4 = ListItem(List=merge, Index=0, Wrap=True)
merge_2 = Merge(Data1=item.Item, Data2=item.Item1, Data3=item.Item2)
# 提取旋转角度
num = Number(item_2)
# 提取原点
pt = Point(item_4)
提取房间方位 = Integer(merge_2)
# 提取房间总数
int = Integer(item_3)
addition = Addition(A=number_slider, B=int)
subtraction = Subtraction(A=addition, B=2)
# 提取下个房间方向
dom = ConstructDomain(DomainStart=subtraction, DomainEnd=number_slider)
multiplication = Multiplication(A=int, B=6)
subtraction_2 = Subtraction(A=lng, B=multiplication)
split = SplitList(List=merge, Index=subtraction_2)  # -> ListA, ListB
partition = PartitionList(List=split.ListB, Size=6)  # -> simplify(Chunks)
subset = SubList(List=merge, Domain=dom, Wrap=True)  # -> List, Index
# 提取房间的信息
filter = StreamFilter(Gate=1, Stream1=partition)
panel_2 = Panel(int)
int_2 = Integer(subset.List)
rad = Radians(Degrees=num)
panel_3 = Panel("""上：0
下：1
左：2
右：3""")
prot = RotatePlane(Plane=pt, Angle=rad)
deplane = DeconstructPlane(Plane=prot)  # -> Origin, XAxis, YAxis, ZAxis

# ----
# 获取墙厚
item_5 = ListItem(List=filter, Index=2, Wrap=True)
item_6 = ListItem(List=flatten(item_5), Index=0, Wrap=True)

num_2 = Number(flatten(item_5))
shift = ShiftList(List=num_2, Shift=1, Wrap=False)
# 墙之间的差值
shift_2 = ShiftList(List=num_2, Shift=-1, Wrap=False)
panel_4 = Panel(item_5)
panel_5 = Panel(num_2)

# ----
# 获取洞宽
item_7 = ListItem(List=filter, Index=5, Wrap=True)
item_8 = ListItem(List=flatten(item_7), Index=0, Wrap=True)

# ----
# 获取开洞点的长
item_9 = ListItem(List=filter, Index=4, Wrap=True)
item_10 = ListItem(List=flatten(item_9), Index=0, Wrap=True)

# ----
# 获取房间宽
item_11 = ListItem(List=filter, Index=1, Wrap=True)
item_12 = ListItem(List=flatten(item_11), Index=0, Wrap=True)

num_3 = Number(flatten(item_11))

# ----
# 获取开门位置
item_13 = ListItem(List=filter, Index=3, Wrap=True)
item_14 = ListItem(List=flatten(item_13), Index=0, Wrap=True)

# ----
# 获取房间长
item_15 = ListItem(List=filter, Index=0, Wrap=True)
item_16 = ListItem(List=flatten(item_15), Index=0, Wrap=True)

num_4 = Number(flatten(item_15))
# 根据方向选择他们的移动距离
python = PythonScript(x=num_4, y=num_3, z=int_2)  # -> out, a; inputs x: list, y: list, z: list
# ---------- python: Python ----------
#根据方向以及在列表的位置求出移动的距离
a = []
for i in range(len(z)):
    if z[i] == 0:
        a.append(y[i])
    if z[i] == 1:
        a.append(y[i+1])
    if z[i] == 2:
        a.append(x[i+1])
    if z[i] == 3:
        a.append(x[i])
# ---------- end python ----------
依次移动的距离 = Number(python.a)
X = ClusterOutput(deplane.XAxis)
Y = ClusterOutput(deplane.YAxis)
panel_6 = Panel(shift)
i = ClusterOutput(item_11)
i_2 = ClusterOutput(item_13)
i_3 = ClusterOutput(item_15)
y向量 = Vector(deplane.YAxis)
x向量 = Vector(deplane.XAxis)
# 根据方向选择他们的移动的向量
python_2 = PythonScript(x=x向量, y=y向量, z=int_2)  # -> out, a; inputs z: list
# ---------- python_2: Python ----------
#根据方向来判断输出的向量
a = []
for i in z:
    if i == 0:
        a.append(y)
    elif i == 1:
        a.append(-y)
    elif i == 2:
        a.append(-x)
    elif i == 3:
        a.append(x)
    else:
        None
# ---------- end python_2 ----------
原点依次移动的向量 = Vector(python_2.a)
addition_2 = Addition(A=依次移动的距离, B=shift)
panel_7 = Panel(原点依次移动的向量)
总移动距离 = Number(addition_2)
洞宽 = Number(item_7)
墙厚 = Number(item_5)
洞点到边的距离 = Number(item_9)
开门位置 = Integer(item_13)
房间宽 = Number(item_11)
房间长 = Number(item_15)
panel_9 = Panel(filter)
amp = Amplitude(Vector=原点依次移动的向量, Amplitude=总移动距离)
ma = MassAddition(Input=amp)  # -> Result, PartialResults
原点位置 = Point(deplane.Origin)

neg = Negative(Value=x向量)
# 根据相应的开墙位置选择点
# 比如在上面的话
# 原点会向x移动长，向y移动宽。
# 就会到达左上角。
# 这时候再根据位置墙位进行排布。
neg_2 = Negative(Value=y向量)
x向量_2 = Vector(neg)
x向量_3 = Vector(deplane.XAxis)
y向量_2 = Vector(neg_2)
y向量_3 = Vector(deplane.YAxis)
python_3 = PythonScript(x=开门位置, y=x向量_2, z=x向量_3, u=y向量_2, v=y向量_3)  # -> out, a; inputs x: list
# ---------- python_3: Python ----------
a = []
for i in x:
    if i == 0:
        a.append(y)
    if i == 1:
        a.append(z)
    if i == 2:
        a.append(u)
    if i == 3:
        a.append(v)
# ---------- end python_3 ----------

addition_3 = Addition(A=原点位置, B=ma.PartialResults)
merge_3 = Merge(Data1=deplane.Origin, Data2=addition_3)  # -> flatten(Result)
pt_2 = Point(merge_3)
原点位置_2 = Point(graft(pt_2))

neg_3 = Negative(Value=x向量)
neg_4 = Negative(Value=y向量)
amp_2 = Amplitude(Vector=neg_3, Amplitude=墙厚)
amp_3 = Amplitude(Vector=neg_4, Amplitude=墙厚)
addition_4 = Addition(A=amp_2, B=amp_3)
addition_5 = Addition(A=原点位置_2, B=addition_4)
外墙点 = Point(addition_5)

pl = ConstructPlane(Origin=外墙点, XAxis=x向量, YAxis=y向量)
multiplication_2 = Multiplication(A=墙厚, B=2)
multiplication_3 = Multiplication(A=墙厚, B=2)
# 外层墙壁壳
addition_6 = Addition(A=房间长, B=multiplication_2)
addition_7 = Addition(A=房间宽, B=multiplication_3)
rectangle = Rectangle(Plane=pl, XSize=addition_6, YSize=addition_7, Radius=0)  # -> Rectangle, Length

# ----
# 对应上0，得到右上角的点
amp_4 = Amplitude(Vector=x向量, Amplitude=房间长)
amp_5 = Amplitude(Vector=y向量, Amplitude=房间宽)
addition_8 = Addition(A=amp_4, B=amp_5)
addition_9 = Addition(A=原点位置_2, B=addition_8)

# ----
# 对应左2，得到左上角的点
amp_6 = Amplitude(Vector=y向量, Amplitude=房间宽)
addition_10 = Addition(A=原点位置_2, B=amp_6)

# ----
# 对应右3，得到右下角的点
amp_7 = Amplitude(Vector=x向量, Amplitude=房间长)
addition_11 = Addition(A=原点位置_2, B=amp_7)

# ----
# 内层墙壁壳
pl_2 = ConstructPlane(Origin=原点位置_2, XAxis=x向量, YAxis=y向量)
rectangle_2 = Rectangle(Plane=pl_2, XSize=房间长, YSize=房间宽, Radius=0)  # -> Rectangle, Length

panel_10 = Panel(addition_4)
R = ClusterOutput(addition_10)
R_2 = ClusterOutput(addition_11)
R_3 = ClusterOutput(rectangle_2.Rectangle)
R_4 = ClusterOutput(addition_9)
pt_3 = Point(merge_3)
pt_4 = ClusterOutput(pt_3)
panel_12 = Panel("""在上面的往-x移
在下面的往x移
在左面的往-y移
在右面的往y移""")
panel_13 = Panel(外墙点)
内圈左上角点 = Point(addition_10)
内圈右下角点 = Point(addition_11)
内圈右上角点 = Point(addition_9)
原点位置_3 = Point(pt_3)
内层墙壁壳 = Curve(rectangle_2.Rectangle)
外层墙壁壳 = Curve(rectangle.Rectangle)
python_4 = PythonScript(x=flatten(开门位置), y=flatten(内圈右上角点), z=flatten(原点位置_3), u=flatten(内圈左上角点), v=flatten(内圈右下角点))  # -> out, a; inputs x: list, y: list, z: list, u: list, v: list
# ---------- python_4: Python ----------
a = []
for i in range(len(x)):
    if x[i] == 0:
        a.append(y[i])
    if x[i] == 1:
        a.append(z[i])
    if x[i] == 2:
        a.append(u[i])
    if x[i] == 3:
        a.append(v[i])
# ---------- end python_4 ----------
panel_14 = Panel(开门位置)
应该移动的向量 = Vector(python_3.a)
此时的墙洞起始点 = Point(python_4.a)
amp_8 = Amplitude(Vector=应该移动的向量, Amplitude=洞宽)
amp_9 = Amplitude(Vector=应该移动的向量, Amplitude=洞点到边的距离)
panel_15 = Panel(应该移动的向量)
addition_12 = Addition(A=amp_9, B=graft(此时的墙洞起始点))
panel_16 = Panel(此时的墙洞起始点)

墙洞靠近起点的那点 = Point(addition_12)

addition_13 = Addition(A=amp_8, B=墙洞靠近起点的那点)

墙洞的另一点 = Point(addition_13)

merge_4 = Merge(Data1=墙洞靠近起点的那点, Data2=墙洞的另一点)
crv_cp = CurveClosestPoint(Point=[墙洞靠近起点的那点, 墙洞的另一点], Curve=内层墙壁壳)  # -> Point, Parameter, Distance
shatter = Shatter(Curve=内层墙壁壳, Parameters=crv_cp.Parameter)
crv_cp_2 = CurveClosestPoint(Point=merge_4, Curve=外层墙壁壳)  # -> Point, Parameter, Distance
shatter_2 = Shatter(Curve=外层墙壁壳, Parameters=crv_cp_2.Parameter)
item_17 = ListItem(List=shatter_2, Index=0, Wrap=True)
item_18 = ListItem(List=shatter, Index=0, Wrap=True)
映射到外壳的两点 = Point(crv_cp_2.Point)
item_19 = ListItem(List=映射到外壳的两点, Index=0, Wrap=True)  # -> Item, Item1
ln = Line(StartPoint=item_19.Item1, EndPoint=墙洞的另一点)  # -> flatten(Line)
ln_2 = Line(StartPoint=item_19.Item, EndPoint=墙洞靠近起点的那点)  # -> flatten(Line)
entwine = Entwine(Branch00=flatten(ln_2), Branch01=flatten(ln), Branch02=flatten(item_18), Branch03=flatten(item_17), FlattenInputs=True)
flip = FlipMatrix(Data=entwine)
join = JoinCurves(Curves=flip, Preserve=False)  # -> flatten(Curves)
C = ClusterOutput(join)

# ==== cluster Cluster_2
框长_x = Slider(1750, range=0..10000)
走道长度 = Slider(1024, range=0..10000)
框宽_y = Slider(1726, range=0..10000)
框长 = ClusterInput()
走道长度_2 = ClusterInput()
框宽 = ClusterInput()
框长_2 = Integer(框长)
走道长度_3 = Integer(走道长度_2)
框宽_2 = Integer(框宽)
# 根据门洞位置提取办公椅的基准点
x = ClusterInput()
y = ClusterInput()
z = ClusterInput()
u = ClusterInput()
v = ClusterInput()
x_2 = ClusterInput()
y_2 = ClusterInput()
z_2 = ClusterInput()
框长_3 = ClusterOutput(框长_2)
multiplication = Multiplication(A=走道长度_3, B=2)
python = PythonScript(x=flatten(x), y=flatten(y), z=flatten(z), u=flatten(u), v=flatten(v))  # -> out, a; inputs x: list, y: list, z: list, u: list, v: list
# ---------- python: Python ----------
a = []
for i in range(len(x)):
    if x[i] == 0:
        a.append(z[i])
    elif x[i] == 1:
        a.append(y[i])
    elif x[i] == 2:
        a.append(v[i])
    else:
        a.append(u[i])
# ---------- end python ----------
python_2 = PythonScript(x=flatten(x_2), y=flatten(y_2), z=flatten(z_2))  # -> out, a, b; inputs x: list, y: list, z: list
# ---------- python_2: Python ----------
a = []
b = []
for i in range(len(x)):
    if x[i] == 0:
        a.append(y[i])
        b.append(z[i])
    elif x[i] == 1:
        a.append(y[i])
        b.append(z[i])
    elif x[i] == 2:
        a.append(z[i])
        b.append(y[i])
    elif x[i] == 3:
        a.append(z[i])
        b.append(y[i])
    else:
        None
# ---------- end python_2 ----------
x_3 = ClusterInput()
y_3 = ClusterInput()
z_3 = ClusterInput()
框宽_3 = ClusterOutput(框宽_2)
addition = Addition(A=框宽_2, B=走道长度_3)
python_3 = PythonScript(x=x_3, y=y_3, z=flatten(z_3))  # -> out, a, b; inputs z: list
# ---------- python_3: Python ----------
a = []
b = []
for i in z:
    if i == 0:
        a.append(x)
        b.append(y)
    elif i == 1:
        a.append(-x)
        b.append(-y)
    elif i == 2:
        a.append(y)
        b.append(-x)
    elif i == 3:
        a.append(-y)
        b.append(x)
    else:
        None
# ---------- end python_3 ----------
panel = Panel("""上：0
下：1
左：2
右：3""")
长_x = Number(python_2.a)
subtraction = Subtraction(A=长_x, B=multiplication)
integer_division = IntegerDivision(A=长_x, B=框长_2)
宽_x = Number(python_2.b)
integer_division_2 = IntegerDivision(A=宽_x, B=addition)
基准点 = Point(python.a)
integer_division_3 = IntegerDivision(A=subtraction, B=框长_2)
最底层框数 = Integer(integer_division)
其他层框数 = Integer(integer_division_3)
层数 = Integer(integer_division_2)
x向量 = Vector(python_3.a)
y向量 = Vector(python_3.b)
multiplication_2 = Multiplication(A=最底层框数, B=框长_2)
x向量_2 = ClusterOutput(x向量)
y向量_2 = ClusterOutput(y向量)
multiplication_3 = Multiplication(A=其他层框数, B=框长_2)
subtraction_2 = Subtraction(A=长_x, B=multiplication_2)
subtraction_3 = Subtraction(A=最底层框数, B=1)
subtraction_4 = Subtraction(A=subtraction, B=multiplication_3)
subtraction_5 = Subtraction(A=其他层框数, B=1)
division = Division(A=subtraction_2, B=subtraction_3)
division_2 = Division(A=subtraction_4, B=subtraction_5)
底层框间间距 = Number(division)
其他层框间间距 = Number(division_2)
addition_2 = Addition(A=其他层框间间距, B=框长_2)
addition_3 = Addition(A=底层框间间距, B=框长_2)
subtraction_6 = Subtraction(A=层数, B=1)
series = Series(Start=0, Step=addition_2, Count=其他层框数)
series_2 = Series(Start=0, Step=addition_3, Count=最底层框数)
python_4 = PythonScript(x=subtraction_6)  # -> out, a; inputs x: list
# ---------- python_4: Python ----------
a = []
for i in x:
    if i == -1:
        a.append(0)
    else:
        a.append(i)
# ---------- end python_4 ----------
amp = Amplitude(Vector=x向量, Amplitude=走道长度_3)
division_3 = Division(A=python_4.a, B=python_4.a)
amp_2 = Amplitude(Vector=graft(x向量), Amplitude=series)  # -> simplify(Vector)
基准点_2 = Point(python.a)
sift = SiftPattern(List=amp, SiftPattern=division_3)  # -> Output0, Output1
sift_2 = SiftPattern(List=subtraction_6, SiftPattern=division_3)  # -> Output0, Output1
sift_3 = SiftPattern(List=基准点_2, SiftPattern=division_3)  # -> Output0, Output1
amp_3 = Amplitude(Vector=graft(x向量), Amplitude=series_2)
addition_4 = Addition(A=graft(基准点), B=amp_3)
series_3 = Series(Start=addition, Step=addition, Count=sift_2.Output1)
amp_4 = Amplitude(Vector=graft(y向量), Amplitude=series_3)
pt = Point(sift_3.Output1)
addition_5 = Addition(A=amp_4, B=graft(sift.Output1))  # -> simplify(Result)
底层框点 = Point(simplify(addition_4))
addition_6 = Addition(A=addition_5, B=graft(pt))
sift_4 = SiftPattern(List=amp_2, SiftPattern=graft(division_3))  # -> Output0, simplify(Output1)
其余起始点 = Point(simplify(addition_6))
cx = CurveSelf()  # -> Points, Params
clean = CleanTree(RemoveNulls=True, RemoveInvalid=True, RemoveEmpty=False, Tree=sift_4.Output1)
clean_2 = CleanTree(RemoveNulls=True, RemoveInvalid=True, RemoveEmpty=False, Tree=其余起始点)
python_5 = PythonScript()  # -> Out, A
lng = ListLength(List=clean)
lng_2 = ListLength(List=clean_2)
multiplication_4 = Multiplication(A=lng_2, B=lng)
division_4 = Division(A=multiplication_4, B=lng)
panel_2 = Panel(division_4)
repeat = RepeatData(Data=clean_2, Length=division_4)
repeat_2 = RepeatData(Data=clean, Length=multiplication_4)
python_6 = PythonScript(x=flatten(division_4))  # -> out, simplify(graft(z)); inputs x: list
# ---------- python_6: Python ----------
z = []
for i in x:
    if i == None:
        z.append(0)
    else:
        z.append(i)
# ---------- end python_6 ----------
partition = PartitionList(List=repeat_2, Size=lng)  # -> simplify(Chunks)
partition_2 = PartitionList(List=repeat, Size=python_6.z)  # -> simplify(Chunks)
crv = Curve(<curve referenced from the Rhino model>)
crv_2 = Curve(<curve referenced from the Rhino model>)
clean_3 = CleanTree(RemoveNulls=True, RemoveInvalid=True, RemoveEmpty=False, Tree=partition)
lng_3 = ListLength(List=clean_3)
graft = GraftTree(Tree=partition_2, IncludeEmptyLists=True, IncludeNullItems=True)  # -> simplify(Tree)
python_7 = PythonScript(x=crv_2, y=crv)  # -> out, a
# ---------- python_7: Python ----------
#coding=utf-8

import rhinoscriptsyntax as rs
import Rhino as r
import ghpythonlib.components as ghc
import math

a = rs.PlanarCurveCollision(x,y)
# ---------- end python_7 ----------
partition_3 = PartitionList(List=clean_3, Size=lng_3)
panel_3 = Panel(lng_3)
addition_7 = Addition(A=graft, B=partition_3)  # -> simplify(Result)
框点 = Point(addition_7)
panel_4 = Panel(partition_2)
path_mapper = PathMapper(框点, source="{A;B}", target="{A}")
pshift = ShiftPaths(Data=框点, Offset=-1)
panel_5 = Panel(框点)
panel_6 = Panel(partition)
bool = Boolean(flatten(path_mapper))
item = ListItem(List=bool, Index=0, Wrap=True)
python_8 = PythonScript(x=item)  # -> out, a
# ---------- python_8: Python ----------
if x == None:
    a = 0 
if x:
    a =1
# ---------- end python_8 ----------
filter = StreamFilter(Gate=python_8.a, Stream0=框点, Stream1=pshift)
merge = Merge(Data1=底层框点, Data2=simplify(filter))
pl = ConstructPlane(Origin=merge, XAxis=graft(x向量), YAxis=graft(y向量))  # -> simplify(Plane)
panel_7 = Panel(filter)
R = ClusterOutput(merge)
内层墙壁壳 = ClusterInput()
rectangle = Rectangle(Plane=pl, XSize=框长_2, YSize=框宽_2, Radius=0)  # -> Rectangle, Length
内层墙壁壳_2 = Curve(内层墙壁壳)
lng_4 = ListLength(List=merge)
panel_8 = Panel(lng_4)
python_9 = PythonScript(x=flatten(内层墙壁壳_2))  # -> out, z; inputs x: list of Curve
# ---------- python_9: Python ----------
print(x)
z = []
for i in x:
    z.append(i)
# ---------- end python_9 ----------
python_10 = PythonScript(x=flatten(merge), y=flatten(lng_4), z=flatten(x向量), u=flatten(y向量))  # -> out, list_1, plane_1, table_1; inputs x: list of Point3d, y: list of Int32, z: list of Vector3d, u: list of Vector3d
# ---------- python_10: Python ----------
#coding=utf-8

import rhinoscriptsyntax as rs
import Rhino as r
import ghpythonlib.components as ghc
import math

n = 0
point_1 = []
vecoter_x = []
vecoter_y = []
for i in range(len(y)):
    point_1.append([])
    n = int(n+y[i])
    for h in range(int(n-y[i]),n):
        point_1[i].append(x[h])   #按组将各个房间内的点区分开来
        

print(point_1[0][0])
for v_1 in z:
    vecoter_x.append(v_1)     #获取各平面的x向量

for v_2 in u:
    vecoter_y.append(v_2)     #获取各平面的y向量

plane_1 = rs.PlaneFromFrame(point_1[1][1],vecoter_x[1],vecoter_y[1])
table_1 = rs.PointAdd(point_1[1][1],450*vecoter_x[1])
# ---------- end python_10 ----------
内层墙壁壳_3 = ClusterOutput(内层墙壁壳_2)
L = ClusterOutput(lng_4)
