# Grasshopper definition weight_project.gh (Grasshopper 0.9.76)
# plug-ins: Python Interpreter

md_slider = MDSlider(slider_value=Point(0, 0, 0.5), SliderMode=0, x_domain=Domain(0, 1), y_domain=Domain(0, 1), z_domain=Domain(0, 1))
s = Slider(123940.299, range=37500..240000.001)
w = Slider(597.945, range=150.001..600.002)
pt = Point(md_slider)
python = PythonScript(area=s, length=w)  # -> out, a
# ---------- python: Python ----------
#coding=utf-8

import rhinoscriptsyntax as rs
import Rhino as r
import ghpythonlib.components as ghc
import math
"""
class Room():
    "定义门类"
    def __init__(self,length,wide):

        self.l = length
        self.w = wide
        self.point1 = None
        self.pointx = None
        self.pointy = None
        self.point2 = None
        self.direction = None
    
    def room_direction(self
        "得出门的方向"
        if self.l <= self.w :
            self.direction = False
        else:
            self.direction = True
        
    def point(self):
        "将点表示"
        point1 = rs.AddPoint(0,0,0)
        pointx = rs.AddPoint(self.l,0,0)
        pointy = rs.AddPoint(0,self.w,0)
        point2 = rs.AddPoint(self.l,self.w,0)

    def draw(self):
        line1 = rs.AddLine(self.point1,self.pointx)
        line2 = rs.AddLine(self.point1,self.pointy)
        line3 = rs.AddLine(self.pointx,self.point2)
        line4 = rs.AddLine(self.pointy,self.point2)
"""

class Hole():
    "定义蹲坑类"
    def __init__(self,length,wide):
        self.length = float(length)
        self.wide = float(wide)
        self.hole_directions = True
        self.x = 0
        self.y = 0
   
    def hole_direction(self,x,y,room_direction):
        "定义蹲坑方位,True表示x边长，False表示y边长"
        if room_direction == True and self.wide < y and self.length < x :
            self.hole_directions = True
            self.x = self.length
            self.y = self.wide
        elif room_direction == False and self.wide < x and self.length < y :
            self.hole_directions = False
            self.x = self.wide
            self.y = self.length
        else:
            self.hole_directions = None

    def draw_hole(self,point1):
        "画出蹲坑"
        hole_point1 = point1
        if self.hole_directions == True:
            hole_point2 = rs.AddPoint(self.length,self.wide,0)
            hole_pointx = rs.AddPoint(self.length,0,0)
            hole_pointy = rs.AddPoint(0,self.wide,0)
            hole_line1 = rs.AddLine(hole_point1,hole_pointx)
            hole_line2 = rs.AddLine(hole_point1,hole_pointy)
            hole_line3 = rs.AddLine(hole_point2,hole_pointx)
            hole_line4 = rs.AddLine(hole_point2,hole_pointy)
            t = [hole_line1,hole_line2,hole_line3,hole_line4]
            
            return t
            
        elif self.hole_directions == False:
            hole_point2 = rs.AddPoint(self.wide,self.length,0)
            hole_pointx = rs.AddPoint(self.wide,0,0)
            hole_pointy = rs.AddPoint(0,self.length,0)
            hole_line1 = rs.AddLine(hole_point1,hole_pointx)
            hole_line2 = rs.AddLine(hole_point1,hole_pointy)
            hole_line3 = rs.AddLine(hole_point2,hole_pointx)
            hole_line4 = rs.AddLine(hole_point2,hole_pointy)
            t = [hole_line1,hole_line2,hole_line3,hole_line4]
            return t
            
        else:
            return None
        
class Door():
    "定义门"
    def __init__(self,door_r):
        self.door_r = door_r
        self.door_point = rs.AddPoint(0,0,0)
        self.door_plane = None
    def door_points(self,hole_directions,pointx,pointy,point2,room_x,room_y,hole_length):
        "定义门位置点"
        if hole_directions == True:
            self.door_point = pointx
            if (room_x - hole_length) < self.door_r:
                self.door_point = point2
        elif hole_directions == False:
            self.door_point = pointy
            if (room_y - hole_length) < self.door_r:
                self.door_point = point2
        else:
            self.door_point = None
            
    def door_draw(self,pointx,pointy,point1,point2):
        "画出门"
        pi = math.pi
        if self.door_point == pointx:
            self.door_plane = rs.PlaneFromPoints(pointx,point2,point1)
            angle = ghc.ConstructDomain(0,0.5*pi)
            do = ghc.Arc(self.door_plane,90,angle)
            return do
        elif self.door_point == pointy:
            self.door_plane = rs.PlaneFromPoints(pointy,point1,point2)
            angle = ghc.ConstructDomain(-1.5*pi,-2*pi)
            do = ghc.Arc(self.door_plane,90,angle)
            return do
        elif self.door_point == point2:
            self.door_plane = rs.PlaneFromPoints(point2,pointy,pointx)
            angle = ghc.ConstructDomain(0.5*pi,0)
            do = ghc.Arc(self.door_plane,90,angle)
            return do
        else:
            return None

class Sink():
    "定义水槽"
    def __init__(self,length,wide):
        #最低长
        self.length = length
        #标准宽度
        self.wide = wide
        self.point = None
        
    def sink_points(self,pointx,pointy,point2,l,w,door,hole):
        "选择水槽的点，如果门在xy，那么水槽在yx。太小就去对角点。如果门在对角点，水槽选择xy中大的。"
        if door.door_point == pointx:
            self.point = pointy
            if (w - hole.y) < self.length:
                self.point = point2
        elif door.door_point == pointy:
            self.point = pointx
            if (l - hole.x) < self.length:
                self.point = point2
        elif door.door_point == point2:
            if (w - hole.y)>(l - hole.x):
                self.point = pointy
            else:
                self.point = pointx
        else:
            return None
                
    def sink_draw(self,pointx,pointy,point2,l,w,room_direction,hole):
        "水槽描绘"
        if self.point == pointx:
            sink_point1 = rs.AddPoint(hole.x,0,0)
            sink_point2 = rs.AddPoint(hole.x,self.wide,0)
            sink_point3 = rs.AddPoint(l,self.wide,0)
            sink_line1 = rs.AddLine(sink_point1,self.point)
            sink_line2 = rs.AddLine(sink_point1,sink_point2)
            sink_line3 = rs.AddLine(sink_point3,self.point)
            sink_line4 = rs.AddLine(sink_point3,sink_point2)
            t = [sink_line1,sink_line2,sink_line3,sink_line4]
            return t
        elif self.point == pointy:
            sink_point1 = rs.AddPoint(0,hole.y,0)
            sink_point2 = rs.AddPoint(self.wide,hole.y,0)
            sink_point3 = rs.AddPoint(self.wide,w,0)
            sink_line1 = rs.AddLine(self.point,sink_point1)
            sink_line2 = rs.AddLine(self.point,sink_point3)
            sink_line3 = rs.AddLine(sink_point2,sink_point1)
            sink_line4 = rs.AddLine(sink_point2,sink_point3)
            t = [sink_line1,sink_line2,sink_line3,sink_line4]
            return t
        elif self.point == point2:
            print('hello')
            if room_direction == True:
                print('hello')
                sink_point1 = rs.AddPoint(l-self.length,w,0)
                sink_point2 = rs.AddPoint(l-self.length,w-self.wide,0)
                sink_point3 = rs.AddPoint(l,w-self.wide,0)
                sink_line1 = rs.AddLine(self.point,sink_point1)
                sink_line2 = rs.AddLine(self.point,sink_point3)
                sink_line3 = rs.AddLine(sink_point2,sink_point1)
                sink_line4 = rs.AddLine(sink_point2,sink_point3)
                t = [sink_line1,sink_line2,sink_line3,sink_line4]
                return t
            elif room_direction == False:
                sink_point1 = rs.AddPoint(l-self.wide,w,0)
                sink_point2 = rs.AddPoint(l-self.wide,w-self.length,0)
                sink_point3 = rs.AddPoint(l,w-self.length,0)
                sink_line1 = rs.AddLine(self.point,sink_point1)
                sink_line2 = rs.AddLine(self.point,sink_point3)
                sink_line3 = rs.AddLine(sink_line2,sink_point1)
                sink_line4 = rs.AddLine(sink_line2,sink_point3)
                t = [sink_line1,sink_line2,sink_line3,sink_line4]
                return t
            else:
                return None
        else:
            return None
            
def main():
    s = float(area)
    l = float(length)
    w = float(s/l)
    hole_length = 220
    hole_wide = 120
    room_direction = False

    point1 = rs.AddPoint(0,0,0)
    pointx = rs.AddPoint(l,0,0)
    pointy = rs.AddPoint(0,w,0)
    point2 = rs.AddPoint(l,w,0)


    line1 = rs.AddLine(point1,pointx)
    line2 = rs.AddLine(point1,pointy)
    line3 = rs.AddLine(pointx,point2)
    line4 = rs.AddLine(pointy,point2)

    #定义这个房间是x长还是y长，如果x长就是True，y长就是False
    if l <= w :
        room_direction = False
    else:
        room_direction = True

    #坑的类
    hole = Hole(hole_length,hole_wide)
    hole.hole_direction(l,w,room_direction)
    b = hole.draw_hole(point1)
    #门的类
    door = Door(90)
    door.door_points(hole.hole_directions,pointx,pointy,point2,l,w,hole_length)
    d = door.door_draw(pointx,pointy,point1,point2)
    #水槽的类
    sink = Sink(100,55)
    sink.sink_points(pointx,pointy,point2,l,w,door,hole)
    s = sink.sink_draw(pointx,pointy,point2,l,w,room_direction,hole)
    #整合在一起
    a = [line1,line2,line3,line4]
    for x in range(len(b)):
        a.append(b[x])
    for x in range(len(d)):
        a.append(d[x])
    for x in range(len(s)):
        a.append(s[x])
    return a

a = main()
# ---------- end python ----------
panel = Panel(python.a)
pt_2 = Point()
